# Grasshopper definition BrepTest.ghx (Grasshopper 1.0.7)
# plug-ins: Speckle 2, MeshEdit Components

number_slider = Slider(3, range=0..10)
number_slider_2 = Slider(3, range=0..10)
number_slider_3 = Slider(2, range=0..10)
range = Range(Domain=Domain(0, 1), Steps=number_slider)
range_2 = Range(Domain="-2 to 2", Steps=number_slider_2)
pt = Point(Point(0, 0, 0))
number_slider_4 = Slider(0.4, range=0..1)
pt_2 = ConstructPoint(XCoordinate=graft(range), YCoordinate=range, ZCoordinate=0)
pt_3 = Point(Point(0.7966847394, 0.07208809119, 1.252480454))
pt_4 = Point(Point(0.7966847394, 0.07208809119, 0.135139581))
pt_5 = Point(Point(-0.2375516705, 0.07208809119, -0.2489613433))
pt_6 = ConstructPoint(XCoordinate=graft(range_2), YCoordinate=range_2, ZCoordinate=0)
pt_7 = ConstructPoint(XCoordinate=graft(range_2), YCoordinate=0, ZCoordinate=range_2)
cyl = Cylinder(Base=pt, Radius=0.5, Length=Slider(1, range=0..10))
box = CenterBox(Base=pt_4, X=number_slider_3, Y=number_slider_4, Z=number_slider_4)
srfgrid = SurfaceFromPoints(Points=flatten(pt_2), UCount=expr("x+1", number_slider), Interpolate=False)
box_2 = CenterBox(Base=pt_3, X=number_slider_4, Y=number_slider_4, Z=number_slider_3)
pt_8 = Point(Tree({0;0;0}: [Point(-2, -2, 0), Point(-2, -0.6666666667, 0), Point(-2, 0.6666666667, 0), Point(-2, 2, 0)], {0;0;1}: [Point(-0.6666666667, -2, 0), Point(-0.6666666667, -0.6666666667, -1.468956097), Point(-0.6666666667, 0.6666666667, 1.305453651), Point(-0.6666666667, 2, -0.9238310205)], {0;0;2}: [Point(0.6666666667, -2, 0), Point(0.6666666667, -0.6666666667, 2.759774879), Point(0.6666666667, 0.6666666667, -0.1358726263), Point(0.6666666667, 2, 0)], {0;0;3}: [Point(2, -2, -1.643371203), Point(2, -0.6666666667, 0), Point(2, 0.6666666667, 0), Point(2, 2, 0)]))
pt_9 = Point(Tree({0;0;0}: [Point(-2, 0, -2), Point(-2, 0, -0.6666666667), Point(-2, -1.157601878, 0.6666666667), Point(-2, -1.531644715, 2)], {0;0;1}: [Point(-0.6666666667, 0, -2), Point(-0.6666666667, -0.339197191, -0.6666666667), Point(-0.6666666667, 2.598013607, 0.6666666667), Point(-0.6666666667, 0, 2)], {0;0;2}: [Point(0.6666666667, -1.084035409, -2), Point(0.6666666667, 0.2769907449, -0.6666666667), Point(0.2187878199, -0.6758975856, 0.6666666667), Point(0.6666666667, -0.9859577286, 2)], {0;0;3}: [Point(2, 0, -2), Point(2, 2.242105939, -0.6666666667), Point(2, 0, 0.6666666667), Point(2, 0, 2)]))
cap = CapHoles(Brep=cyl)
box_3 = CenterBox(Base=PlaneXY(0, 0, 0), X=1, Y=1, Z=1)
box_4 = CenterBox(Base=pt_5, X=number_slider_4, Y=number_slider_3, Z=number_slider_4)
Z = UnitZ(Factor=Slider(3, range=0..10))
cir = Circle(Plane=PlaneXY(0, 0, 0), Radius=1)
srfgrid_2 = SurfaceFromPoints(Points=flatten(pt_8), UCount=expr("x+1", number_slider_2), Interpolate=False)
srfgrid_3 = SurfaceFromPoints(Points=flatten(pt_9), UCount=expr("x+1", number_slider_2), Interpolate=False)
brep = Brep(box_3)
trim = TrimSolid(Shape=srfgrid, Cutters=cap)
number_slider_5 = Slider(1, range=0..1)
Z_2 = UnitZ(Factor=Slider(-0.6682, range=-1..1))
python = GhPythonScript(x=cir)  # -> out, a
# ---------- python: Python ----------
import Rhino.Geometry as rg

a = x.ToNurbsCurve()
# ---------- end python ----------
sdiff = SolidDifference(BrepsA=brep, BrepsB=cap)
extr = Extrude(Base=cir, Direction=Z)
sdiff_2 = SolidDifference(BrepsA=brep, BrepsB=[box_2, box, box_4, cap])
sdiff_3 = SolidDifference(BrepsA=brep, BrepsB=[box_2, box, box_4])
move = Move(Geometry=srfgrid_2, Motion=Z_2)  # -> Geometry, Transform
scale = Scale(Geometry=sdiff, Center=Point(0, 0, 0), Factor=Slider(10, range=0..10))  # -> Geometry, Transform
to_speckle = ToSpeckle(Objects=python.a, KitName="Objects")
python_2 = GhPythonScript(y=cyl)  # -> out, a, b; inputs x: Brep, y: Surface
# ---------- python_2: Python ----------
b = y.ToNurbsSurface()
# ---------- end python_2 ----------
flip = Flip(Surface=[srfgrid_2, srfgrid_3])  # -> Surface, Result
to_native = ToNative(Objects=to_speckle, KitName="Objects")
msphereex = MeshSphereEx(Base=PlaneXY(0, 0, 0), Radius=10, Count=5)
series = Series(Start=0, Step=number_slider_5, Count=Slider(2, range=0..10))
relay = Relay([move.Geometry, srfgrid_3])
sdiff_4 = SolidDifference(BrepsA=sdiff_2, BrepsB=relay)
to_speckle_2 = ToSpeckle(Objects=sdiff_4, KitName="Objects")
to_native_2 = ToNative(Objects=to_speckle_2, KitName="Objects")
srl = Serialize(O=to_speckle_2)
pt_10 = Point([Point(6.933961729, -3.869629055, 0), Point(1.136003693, -4.208899822, 0), Point(-1.896360791, 0.3341178344, 0), Point(1.091799117, 4.477686545, 0), Point(5.849853553, 4.470350256, 0), Point(6.017103486, -0.02678989034, 0)])
pt_11 = Point(Point(1, 1, 1))
pt_12 = Point(Point(0, 0, 0))
to_speckle_3 = ToSpeckle(Objects=srfgrid, KitName="Objects")
crv = Curve(to_native)
explode = MeshExplode(Mesh=msphereex, Interpolate=False)
pline = PolyLine(Vertices=pt_10, Closed=invert(False))
brep_2 = Brep(to_native_2)
pt_13 = ConstructPoint(XCoordinate=graft(series), YCoordinate=series, ZCoordinate=0)
pt_14 = Point([Point(-7.817333337, -6.253343826, 0), Point(-10.02456968, 4.172836202, 1.830920992), Point(10.16226121, 8.408412446, 0), Point(8.777132862, -4.740103994, 0), Point(28.25383308, -7.153124511, 0), Point(27.50993698, 8.01810969, 0)])
box_5 = Box2Pt(PointA=pt_12, PointB=pt_11, Plane=PlaneXY(0, 0, 0))
deserialize = Deserialize(O=srl)
panel = Panel(to_speckle_3)
item = ListItem(List=pt_14, Index=0, Wrap=True)  # -> Item, Item1, Item2, Item3, Item4, Item5
brep_3 = Brep([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])
brep_4 = Brep(box_5)
preview = CustomPreview(
    Geometry=brep_2,
    Material={diffuse=RGB(221, 160, 221), emission=RGB(66, 48, 66), shine=0.5, specular=RGB(255, 255, 255), transparency=0})
to_native_3 = ToNative(Objects=deserialize, KitName="Objects")
split = SplitList(List=explode, Index=Slider(100, range=0..100))  # -> ListA, ListB
c_script = CSharpScript(x=brep_4)  # -> out, A; inputs x: Brep
# ---------- c_script: C# ----------
    x.Compact();
    A = x;
# ---------- end c_script ----------
rectangle = Rectangle(Plane=pt_13, XSize=number_slider_5, YSize=number_slider_5, Radius=0)  # -> Rectangle, Length
brep_5 = Brep(to_native_3)
debrep = DeconstructBrep(Brep=brep_2)  # -> Faces, Edges, Vertices
srf4pt = _4PointSurface(CornerA=item.Item, CornerB=item.Item1, CornerC=item.Item2, CornerD=item.Item3)
split_2 = SplitBrep(Brep=srf4pt, Cutter=pline)
srf4pt_2 = _4PointSurface(CornerA=item.Item3, CornerB=item.Item2, CornerC=item.Item5, CornerD=item.Item4)
to_speckle_4 = ToSpeckle(Objects=c_script.A, KitName="Objects")
demesh = DeconstructMesh(Mesh=split.ListA)  # -> Vertices, Faces, Colours, Normals
pt_15 = Point(Point(-2.493162629, -5.41604814, 0))
srf = Surface(flatten(rectangle.Rectangle))
xz = XZPlane(Origin=Point(0, 0, 0))
edges = BrepEdges(Brep=brep_2)  # -> Naked, Interior, NonManifold
item_2 = ListItem(List=demesh.Vertices, Index=0, Wrap=True)  # -> Item, Item1, Item2, Item3, Item4
edges_2 = BrepEdges(Brep=cyl)  # -> Naked, Interior, NonManifold
srl_2 = Serialize(O=to_speckle_4)
box_6 = CenterBox(Base=pt_15, X=1, Y=1, Z=1)
join = BrepJoin(Breps=srf)  # -> Breps, Closed
brep_6 = Brep([srf4pt, srf4pt_2])
item_3 = ListItem(List=debrep.Faces, Index=Slider(4, range=0..10), Wrap=True)
rectangle_2 = Rectangle(Plane=xz, XSize=Domain(-1, 1), YSize=Domain(-2, 2), Radius=0)  # -> Rectangle, Length
srf4pt_3 = _4PointSurface(CornerA=item_2.Item, CornerB=item_2.Item1, CornerC=item_2.Item2, CornerD=item_2.Item3)
join_2 = BrepJoin(Breps=brep_6)  # -> Breps, Closed
split_3 = SplitBrep(Brep=srf4pt, Cutter=box_6)
edges_3 = BrepEdges(Brep=item_3)  # -> Naked, Interior, NonManifold
sdiff_5 = SolidDifference(BrepsA=srf4pt, BrepsB=box_6)
item_4 = ListItem(List=edges.Naked, Index=Slider(0, range=0..4), Wrap=True)
item_5 = ListItem(List=edges_2.Naked, Index=Slider(0, range=0..4), Wrap=True)
split_4 = SplitBrep(Brep=join_2.Breps, Cutter=box_6)
srf_2 = Surface(rectangle_2.Rectangle)
md_slider = MDSlider(SliderMode=0, slider_value=Point(0.5, 0.5, 0.5), x_domain=Domain(0, 1), y_domain=Domain(0, 1), z_domain=Domain(0, 1))
item_6 = ListItem(List=split_2, Index=0, Wrap=True)
number_slider_6 = Slider(6, range=0..10)
item_7 = ListItem(List=split_3, Index=0, Wrap=True)
cp = ControlPoints(Curve=item_4)  # -> Points, Weights, Knots
cp_2 = ControlPoints(Curve=item_5)  # -> Points, Weights, Knots
curvepoint = PointOnCurve(debrep.Edges, parameter=0.333)
curvepoint_2 = PointOnCurve([debrep.Edges, edges.Interior], parameter=0.333)
item_8 = ListItem(List=split_4, Index=0, Wrap=True)
multiplication = Multiplication(A=cp.Points, B=cp.Weights)
subtraction = Subtraction(A=cp.Points, B=cp_2.Points)
division = Division(A=subtraction, B=cp.Weights)
evalsrf = EvaluateSurface(Surface=reparameterize(srfgrid_3), Point=md_slider)  # -> Point, Normal, UDirection, VDirection, Frame
vlen = VectorLength(Vector=division)
panel_2 = Panel(vlen)
panel_3 = Panel(cp_2.Points)
box_7 = CenterBox(Base=evalsrf.Point, X=1, Y=1, Z=1)
split_5 = SplitBrep(Brep=srfgrid_3, Cutter=box_7)
item_9 = ListItem(List=split_5, Index=0, Wrap=True)
c_script_2 = CSharpScript(x=item_9)  # -> out, A; inputs x: Brep
# ---------- c_script_2: C# ----------
    x.Compact();
    x.MakeValidForV2();
    x.Repair(0.0001);
    A = x;
# ---------- end c_script_2 ----------
to_speckle_5 = ToSpeckle(Objects=c_script_2.A, KitName="Objects")
srl_3 = Serialize(O=to_speckle_5)
panel_4 = Panel(srl_3)
deserialize_2 = Deserialize(O=srl_3)
to_native_4 = ToNative(Objects=deserialize_2, KitName="Objects")
brep_7 = Brep(to_native_4)
