# Grasshopper definition SurfaceTests.ghx (Grasshopper 1.0.7)
# plug-ins: Speckle 2

number_slider = Slider(4, range=0..10)
accounts = Accounts(
    {"Account (alan@rynne.es | https://staging.speckle.dev)": "ead7b5bb692081ceb2ed3cde2b088187", "Account (alan@rynne.es | http://localhost:3000)": "c17e3b5af2f177869a733cca10850355", "Account (alan@speckle.systems | https://staging.speckle.dev)": "4f3b8d2197550b86f070c641aebd21a8"}, selected="Account (alan@rynne.es | https://staging.speckle.dev)",
    selectedId="ead7b5bb692081ceb2ed3cde2b088187",
    selectedServer="https://staging.speckle.dev")
series = Series(Start=0, Step=1, Count=number_slider)
construct_point = ConstructPoint(XCoordinate=graft(series), YCoordinate=series, ZCoordinate=0)
surface_from_points = SurfaceFromPoints(Points=flatten(construct_point), UCount=number_slider, Interpolate=False)
id_7ed7a7d55e = CreateStream(Account=accounts, stream="7ed7a7d55e https://staging.speckle.dev ead7b5bb692081ceb2ed3cde2b088187")

create_speckle_object = CreateSpeckleObject(A=surface_from_points)
serialize = Serialize(O=create_speckle_object)
deserialize = Deserialize(O=serialize)
expand_speckle_object = ExpandSpeckleObject(SpeckleObject=create_speckle_object)
expand_speckle_object_2 = ExpandSpeckleObject(SpeckleObject=deserialize)
panel = Panel(expand_speckle_object)
panel_2 = Panel(expand_speckle_object_2)
surface = Surface(expand_speckle_object)
surface_2 = Surface(expand_speckle_object_2)

send = Send(
    Data=create_speckle_object,
    Stream=id_7ed7a7d55e,
    Branch="main",
    AutoSend=False,
    BaseId="20b7e4e75260cf8eb5abcd59599399f6",
    CurrentComponentState="up_to_date",
    KitName="Objects",
    OutputWrappers="https://staging.speckle.dev\t7ed7a7d55e\te56b6b64b5",
    UseDefaultCache=True)  # -> Commits, ObjectId, Data

# ---- group: Conversion Nodes
to_speckle = ToSpeckle(Objects=surface_from_points, KitName="Objects")
serialize_2 = Serialize(O=to_speckle)
deserialize_2 = Deserialize(O=serialize_2)
to_native = ToNative(Objects=to_speckle, KitName="Objects")
to_native_2 = ToNative(Objects=deserialize_2, KitName="Objects")
panel_3 = Panel(to_native)
panel_4 = Panel(to_native_2)
surface_3 = Surface(to_native)
surface_4 = Surface(to_native_2)

# ----
receive = Receive(
    Stream=id_7ed7a7d55e,
    AutoReceive=False,
    CurrentComponentState="up_to_date",
    KitName="Objects",
    LastInfoMessage="Alan Rynne @ 2020-11-06T09:41:38.032Z: Grasshopper push. (id:e56b6b64b5)",
    ReceivedObjectId="20b7e4e75260cf8eb5abcd59599399f6",
    StreamWrapper="https://staging.speckle.dev/streams/7ed7a7d55e?u=ead7b5bb692081ceb2ed3cde2b088187")  # -> Data, Info
expand_speckle_object_3 = ExpandSpeckleObject(SpeckleObject=receive.Data)
panel_5 = Panel(expand_speckle_object_3)
