# Grasshopper definition ExtendObjectTest.ghx (Grasshopper 1.0.7)
# plug-ins: Speckle 2

list = Accounts(
    {"Account (alan@rynne.es | http://localhost:3000)": "c17e3b5af2f177869a733cca10850355"}, selected="Account (alan@rynne.es | http://localhost:3000)",
    selectedId="c17e3b5af2f177869a733cca10850355",
    selectedServer="http://localhost:3000")
list_2 = Accounts(
    {"Account (alan@rynne.es | http://localhost:3000)": "c17e3b5af2f177869a733cca10850355"}, selected="Account (alan@rynne.es | http://localhost:3000)",
    selectedId="c17e3b5af2f177869a733cca10850355",
    selectedServer="http://localhost:3000")
sph = Sphere(Base=PlaneXY(0, 0, 0), Radius=1)
repeat = RepeatData(Data=sph, Length=Slider(100, range=0..100))
entwine = Entwine(Branch00=repeat, FlattenInputs=True)
id_9abc86882e = CreateStream(Account=list, stream="9abc86882e http://localhost:3000 c17e3b5af2f177869a733cca10850355")
sup = StreamUpdate(Stream=id_9abc86882e, Name="asdfas", Description="desc", Public=Toggle(True))
create_object_by_key_value = CreateObjectByKeyValue(Keys="ABBC", Values=entwine)
cso = CreateSpeckleObject(A="/Original", B="/Original", C="/Original")  # -> Debug, SpeckleObject
slist = StreamList(Account=list, Limit=10)
id_5f843f1aaa = CreateStream(Account=list_2, stream="5f843f1aaa http://localhost:3000 c17e3b5af2f177869a733cca10850355")
sget = StreamGet(StreamID=sup, Account=list)
receive = Receive(
    ID=id_5f843f1aaa,
    AutoReceive=False,
    CurrentComponentState="up_to_date",
    LastInfoMessage="Alan Rynne @ 2020-10-23T17:31:01.342Z: Grasshopper push. (id:8ce2e9c16d)",
    ReceivedObjectId="8bc95c4a8861830396eb7f8ef8efc109",
    StreamWrapper="http://localhost:3000/streams/5f843f1aaa?u=c17e3b5af2f177869a733cca10850355")  # -> Data, Info
send = Send(
    Data=create_object_by_key_value,
    Stream=id_5f843f1aaa,
    Branch="main",
    AutoSend=True,
    BaseId="8bc95c4a8861830396eb7f8ef8efc109",
    CurrentComponentState="up_to_date",
    OutputWrappers="http://localhost:3000\t5f843f1aaa\t8ce2e9c16d",
    UseDefaultCache=True)  # -> Commits, ObjectId, Data
receive_2 = Receive(
    ID=id_5f843f1aaa,
    AutoReceive=True,
    CurrentComponentState="up_to_date",
    LastInfoMessage="Alan Rynne @ 2020-10-23T17:31:01.342Z: Grasshopper push. (id:8ce2e9c16d)",
    ReceivedObjectId="8bc95c4a8861830396eb7f8ef8efc109",
    StreamWrapper="http://localhost:3000/streams/5f843f1aaa?u=c17e3b5af2f177869a733cca10850355")  # -> Data, Info
sdet = StreamDetails(StreamID=sget)  # -> StreamID, Name, Description, CreatedAt, UpdatedAt, Public, Collaborators, Branches
eso = ExpandSpeckleObject(SpeckleObject=send.Data)
eso_2 = ExpandSpeckleObject(SpeckleObject=receive.Data)
eso_3 = ExpandSpeckleObject(SpeckleObject=receive_2.Data)
panel = Panel([sdet.Name, sdet.Description, sdet.Public])
sb = SpeckleBase(panel)
panel_2 = Panel(sb)
